# Grasshopper definition algo.gh (Grasshopper 1.0.8)

ground_radius = Panel("10")
ground_radius_2 = Panel("10")
floor_thickness = Panel("3")
floor_thickness_2 = Panel("3")
hight = Panel("20")
hight_2 = Panel("20")
angle = Slider(1.961, range=1..2.25)
angle_2 = Slider(1, range=1..2.25)
twist_angle = Slider(32, range=0..45)
ground_radius_3 = Panel("10")
floor_thickness_3 = Panel("3")
angle_3 = Slider(2.25, range=1..2.25)
hight_3 = Panel("20")
twist_angle_2 = Slider(45, range=0..45)
twist_angle_3 = Slider(4, range=0..45)
xy = XYPlane(Origin=Point(0, 0, 0))
xy_2 = XYPlane(Origin=Point(0, 0, 0))
xy_3 = XYPlane(Origin=Point(0, 0, 0))
twist_angle_4 = Slider(0, range=0..120)
ground_radius_4 = Panel("40")
floor_thickness_4 = Panel("3")
angle_4 = Slider(2.25, range=1..2.25)
hight_4 = Panel("100")
Z = UnitZ(Factor=floor_thickness)
Z_2 = UnitZ(Factor=floor_thickness_2)
polygon = Polygon(Plane=PlaneXY(0, 0, 0), Radius=ground_radius, Segments=Slider(3, range=3..20), FilletRadius=0)  # -> Polygon, Length
polygon_2 = Polygon(Plane=PlaneXY(0, 0, 0), Radius=ground_radius_2, Segments=Slider(20, range=3..20), FilletRadius=0)  # -> Polygon, Length
blob_radius = Panel("5")
pt = ConstructPoint(XCoordinate=ground_radius_4, YCoordinate=0, ZCoordinate=0)
Z_3 = UnitZ(Factor=floor_thickness_3)
polygon_3 = Polygon(Plane=PlaneXY(0, 0, 0), Radius=ground_radius_3, Segments=Slider(9, range=3..20), FilletRadius=0)  # -> Polygon, Length
move = Move(Geometry=polygon.Polygon, Motion=Z)  # -> Geometry, Transform
move_2 = Move(Geometry=polygon_2.Polygon, Motion=Z_2)  # -> Geometry, Transform
Z_4 = UnitZ(Factor=floor_thickness_4)
polygon_4 = Polygon(Plane=PlaneXY(0, 0, 0), Radius=ground_radius_4, Segments=Slider(3, range=3..20), FilletRadius=0)  # -> Polygon, Length
move_3 = Move(Geometry=polygon_3.Polygon, Motion=Z_3)  # -> Geometry, Transform
Z_5 = UnitZ(Factor=hight)
Z_6 = UnitZ(Factor=hight_2)
Z_7 = UnitZ(Factor=hight_3)
polygon_5 = Polygon(Plane=pt, Radius=blob_radius, Segments=Slider(6, range=3..20), FilletRadius=0)  # -> Polygon, Length
move_4 = Move(Geometry=polygon_4.Polygon, Motion=Z_4)  # -> Geometry, Transform
scale = Scale(Geometry=move.Geometry, Center=Point(0, 0, 0), Factor=angle)  # -> Geometry, Transform
scale_2 = Scale(Geometry=move_2.Geometry, Center=Point(0, 0, 0), Factor=angle_2)  # -> Geometry, Transform
Z_8 = UnitZ(Factor=hight_4)
scale_3 = Scale(Geometry=move_3.Geometry, Center=Point(0, 0, 0), Factor=angle_3)  # -> Geometry, Transform
Z_9 = UnitZ(Factor=floor_thickness)
Z_10 = UnitZ(Factor=floor_thickness_2)
srf = Surface(move.Geometry)
srf_2 = Surface(move_2.Geometry)
Z_11 = UnitZ(Factor=floor_thickness_3)
move_5 = Move(Geometry=scale.Geometry, Motion=Z_5)  # -> Geometry, Transform
move_6 = Move(Geometry=scale_2.Geometry, Motion=Z_6)  # -> Geometry, Transform
scale_4 = Scale(Geometry=move_4.Geometry, Center=Point(0, 0, 0), Factor=angle_4)  # -> Geometry, Transform
srf_3 = Surface(move_3.Geometry)
move_7 = Move(Geometry=scale_3.Geometry, Motion=Z_7)  # -> Geometry, Transform
Z_12 = UnitZ(Factor=floor_thickness_4)
rev = Reverse(Vector=Z_9)
rev_2 = Reverse(Vector=Z_10)
rotate = Rotate(Geometry=move_5.Geometry, Angle=degrees(twist_angle_2), Plane=PlaneXY(0, 0, 0))  # -> Geometry, Transform
rotate_2 = Rotate(Geometry=move_6.Geometry, Angle=degrees(twist_angle_3), Plane=PlaneXY(0, 0, 0))  # -> Geometry, Transform
srf_4 = Surface(move_4.Geometry)
move_8 = Move(Geometry=scale_4.Geometry, Motion=Z_8)  # -> Geometry, Transform
rev_3 = Reverse(Vector=Z_11)
rotate_3 = Rotate(Geometry=move_7.Geometry, Angle=degrees(twist_angle), Plane=PlaneXY(0, 0, 0))  # -> Geometry, Transform
arrcurve = CurveArray(Geometry=polygon_5.Polygon, Curve=polygon_4.Polygon, Count=Slider(16, range=3..50))  # -> graft(Geometry), Transform
rev_4 = Reverse(Vector=Z_12)
rotate_4 = Rotate(Geometry=move_8.Geometry, Angle=degrees(twist_angle_4), Plane=PlaneXY(0, 0, 0))  # -> Geometry, Transform
extr = Extrude(Base=srf, Direction=rev)
extr_2 = Extrude(Base=srf_2, Direction=rev_2)
loft = Loft(
    Curves=[rotate_2.Geometry, move_2.Geometry],
    Options={Adjust=False, Closed=False, LoftEnds=0, LoftSimp=0, LoftType=0, Rebuild=10, Refit=0.01})
loft_2 = Loft(
    Curves=[rotate.Geometry, move.Geometry],
    Options={Adjust=False, Closed=False, LoftEnds=0, LoftSimp=0, LoftType=0, Rebuild=10, Refit=0.01})
extr_3 = Extrude(Base=srf_3, Direction=rev_3)
vec = Vector(Vector(-34.83164534, -45.72298366, 0))
vec_2 = Vector(Vector(38.02189059, 41.46284427, 0))
extr_4 = Extrude(Base=srf_4, Direction=rev_4)
loft_3 = Loft(
    Curves=[rotate_3.Geometry, move_3.Geometry],
    Options={Adjust=False, Closed=False, LoftEnds=0, LoftSimp=0, LoftType=0, Rebuild=10, Refit=0.01})
move_9 = Move(Geometry=loft, Motion=vec)  # -> Geometry, Transform
move_10 = Move(Geometry=extr_2, Motion=vec)  # -> Geometry, Transform
move_11 = Move(Geometry=loft_2, Motion=vec_2)  # -> Geometry, Transform
move_12 = Move(Geometry=extr, Motion=vec_2)  # -> Geometry, Transform
ccx = CurveCurve(CurveA=arrcurve.Geometry, CurveB=polygon_4.Polygon)  # -> Points, ParamsA, ParamsB
ccx_2 = CurveCurve(CurveA=arrcurve.Geometry, CurveB=polygon_4.Polygon)  # -> Points, ParamsA, ParamsB
loft_4 = Loft(
    Curves=[rotate_4.Geometry, polygon_4.Polygon],
    Options={Adjust=False, Closed=False, LoftEnds=0, LoftSimp=0, LoftType=0, Rebuild=10, Refit=0.01})
number_slider = Slider(5, range=0..20)
fmerge = MergeFaces(Brep=[move_10.Geometry, move_9.Geometry])  # -> Breps, Before, After
fmerge_2 = MergeFaces(Brep=[extr_3, loft_3])  # -> Breps, Before, After
ma = MassAddition(Input=fmerge_2.After)  # -> Result, PartialResults
number_slider_2 = Slider(10, range=0..20)
number_slider_3 = Slider(15, range=0..20)
ma_2 = MassAddition(Input=fmerge.After)  # -> Result, PartialResults
fmerge_3 = MergeFaces(Brep=[move_11.Geometry, move_12.Geometry])  # -> Breps, Before, After
ma_3 = MassAddition(Input=fmerge_3.After)  # -> Result, PartialResults
shatter = Shatter(Curve=arrcurve.Geometry, Parameters=ccx.ParamsA)
shatter_2 = Shatter(Curve=polygon_4.Polygon, Parameters=ccx_2.ParamsB)
dom = ConstructDomain(DomainStart=ccx_2.ParamsA, DomainEnd=ccx_2.ParamsB)
midpt = CurveMiddle(Curve=shatter_2)
midpt_2 = CurveMiddle(Curve=shatter)
midpt_3 = CurveMiddle(Curve=shatter_2)
panel = Panel([fmerge_3.Before, ma_3.Result])
panel_2 = Panel([fmerge_2.Before, ma.Result])
subcrv = SubCurve(BaseCurve=polygon_4.Polygon, Domain=dom)
dup = DuplicateData(Data=[fmerge_2.Before, ma.Result], Number=number_slider, Order=True)
panel_3 = Panel([fmerge.Before, ma_2.Result])
dup_2 = DuplicateData(Data=[fmerge_3.Before, ma_3.Result], Number=number_slider_3, Order=True)
dup_3 = DuplicateData(Data=[fmerge.Before, ma_2.Result], Number=number_slider_2, Order=True)
incurve = PointInCurve(Point=midpt_2, Curve=polygon_4.Polygon)  # -> reverse(Relationship), Point
incurve_2 = PointInCurve(Point=midpt_3, Curve=arrcurve.Geometry)  # -> Relationship, Point
crv = Curve(subcrv)
panel_4 = Panel(dom)
rev_5 = ReverseList(List=incurve_2.Relationship)
matrix = ConstructMatrix(Rows=number_slider_3, Columns=3, Values=dup_2)
lng = ListLength(List=dup_2)
lng_2 = ListLength(List=dup)
lng_3 = ListLength(List=dup_3)
matrix_2 = ConstructMatrix(Rows=number_slider_2, Columns=3, Values=dup_3)
matrix_3 = ConstructMatrix(Rows=number_slider, Columns=3, Values=dup)
cull = CullPattern(List=shatter, CullPattern=incurve.Relationship)
panel_5 = Panel(rev_5)
matrix_4 = DisplayMatrix(matrix_3)
matrix_5 = DisplayMatrix(matrix)
matrix_6 = DisplayMatrix(matrix_2)
multiplication = Multiplication(A=lng_2, B=Slider(0.5, range=0..1))
multiplication_2 = Multiplication(A=lng, B=Slider(0.5, range=0..1))
multiplication_3 = Multiplication(A=lng_3, B=Slider(0.5, range=0..1))
cull_2 = CullPattern(List=shatter_2, CullPattern=incurve_2.Relationship)
join = JoinCurves(Curves=[cull, polygon_4.Polygon], Preserve=False)
panel_6 = Panel(incurve_2.Relationship)
split = SplitList(List=dup, Index=multiplication)  # -> ListA, ListB
split_2 = SplitList(List=dup_3, Index=multiplication_3)  # -> ListA, ListB
split_3 = SplitList(List=dup_2, Index=multiplication_2)  # -> ListA, ListB
panel_7 = Panel([split.ListA, split_2.ListA, split_3.ListA])
panel_8 = Panel([split.ListB, split_2.ListB, split_3.ListB])
panel_9 = Panel("""0
0
0
1
1
1""")
weave = Weave(
    Pattern=panel_9,
    Stream0=[split.ListA, split_2.ListA, split_3.ListA],
    Stream1=[split.ListB, split_2.ListB, split_3.ListB],
    NullGaps=False)
partition = PartitionList(List=weave, Size=Slider(6, range=1..10))
panel_10 = Panel(partition)
